# Grasshopper definition KlienFractal.gh (Grasshopper 1.0.7)
# plug-ins: Bifocals, LunchBox

multiplication = Multiplication(A=Slider(0.5, range=0..10), B=Slider(1, range=0..10))
pi = Pi(Factor=Slider(2, range=0..5))
pi_2 = Pi(Factor=Slider(2, range=0..10))
dom = ConstructDomain(DomainStart=0, DomainEnd=pi_2)
dom_2 = ConstructDomain(DomainStart=0, DomainEnd=pi)
basesurface = KleinSurface(
    UDivisions=Slider(50, range=0..100),
    VDivisions=Slider(24, range=0..100),
    RParameter=Slider(2, range=0..10),
    TParameter=multiplication,
    Scale=Slider(10, range=0..10),
    Domain1=dom,
    Domain2=dom_2)
quadstag = StaggeredQuadPanels(Surface=basesurface, UDivisions=Slider(40, range=0..100), VDivisions=Slider(20, range=0..100))  # -> graft(Panels)
area = Area(Geometry=quadstag)  # -> Area, Centroid
bnd = Bounds(Numbers=flatten(area.Area))
remap = RemapNumbers(Value=area.Area, Source=bnd, Target=Domain(0, 1))  # -> Mapped, Clipped
md_slider = MDSlider(SliderMode=0, slider_value=Point(0.5, 0.5, 0.5), x_domain=Domain(0, 1), y_domain=Domain(0, 1), z_domain=Domain(0, 1))
graph = GraphMapper(
    remap.Mapped,
    x0=0,
    x1=1,
    y0=0,
    y1=1,
    container_name="Bezier",
    cpx=[0, 0.4519060552, 0.6145603061, 1],
    cpy=[0.1814937592, 0.2911907434, 0.8661543131, 1])
evalsrf = EvaluateSurface(Surface=reparameterize(quadstag), Point=md_slider)  # -> Point, Normal, UDirection, VDirection, Frame
multiplication_2 = Multiplication(A=graph, B=Slider(8, range=0..10))
division = Division(A=multiplication_2, B="2")
amp = Amplitude(Vector=evalsrf.Normal, Amplitude=division)  # -> simplify(Vector)
neg = Negative(Value=amp)
move = Move(Geometry=quadstag, Motion=neg)  # -> Geometry, Transform
mesh = Mesh(basesurface)
sbox = SurfaceBox(Surface=move.Geometry, Domain=move.Geometry, Height=multiplication_2)  # -> simplify(graft(TwistedBox))
brep = Brep(sbox)
bbox = BoundingBox(Content=mesh, Plane=PlaneXY(0, 0, 0))  # -> Box, Box_2
morph = BoxMorph(Geometry=mesh, Reference=bbox.Box, Target=sbox)
preview = CustomPreview(Geometry=morph, Material=ColourSwatch(SwatchColor=RGB(181, 181, 181)))  # disabled
